% Simulink data dictionary site_grid_behavior_ev_charging_v3_params.sldd

scenario_params = struct(
  model_version="3.0.0",
  scenario_id="SYN001_2026_baseline",
  site_id="SYN001",
  horizon_year=2026,
  capacity_basis="placeholder",
  capacity_kW=200,
  charger_power_kW=19.2,
  ports=2,
  profile_mode="deterministic_sessions",
  dt_sec=300,
  stop_time_sec=86400,
  built_utc="2026-07-27T19:08:03Z",
  note="Illustrative Simulink layer; metrics are computed by the base-MATLAB pipeline, not by this model.")